# Grasshopper definition african bead clean.gh (Grasshopper 0.9.76)

srf = Surface(<surface referenced from the Rhino model>)
divide = DivideDomain²(Domain=srf, UCount=Slider(35, range=0..40), VCount=Slider(20, range=0..140))
subsrf = Isotrim(Surface=srf, Domain=divide)
area = Area(Geometry=subsrf)  # -> Area, Centroid
division = Division(A=area.Area, B=3.14)
sqrt = SquareRoot(Value=division)
srf_cp = SurfaceClosestPoint(Point=area.Centroid, Surface=subsrf)  # -> Point, UVPoint, Distance
division_2 = Division(A=sqrt, B=7.5)
addition = Addition(A=sqrt, B=division_2)
evalsrf = EvaluateSurface(Surface=subsrf, Point=srf_cp.UVPoint)  # -> Point, Normal, Frame
pl = PlaneNormal(Origin=srf_cp.Point, ZAxis=evalsrf.Normal)
sph = Sphere(Base=pl, Radius=addition)
