# Grasshopper definition mashup_vase_1_for_ui.gh (Grasshopper 0.9.76)

number_slider = Slider(5, range=0..8)
number_slider_2 = Slider(8, range=0..8)
srf = Surface(<surface referenced from the Rhino model>)
geo = Geometry(<brep referenced from the Rhino model>)
geo_2 = Geometry(<brep referenced from the Rhino model>)
divide = DivideDomain²(Domain=srf, UCount=number_slider_2, VCount=number_slider)
bbox = BoundingBox(Content=geo, Plane=PlaneXY(0, 0, 0))  # -> Box, Box_2
bbox_2 = BoundingBox(Content=geo_2, Plane=PlaneXY(0, 0, 0))  # -> Box, Box_2
multiplication = Multiplication(A=number_slider_2, B=number_slider)
subsrf = Isotrim(Surface=srf, Domain=divide)
division = Division(A=Slider(65, range=0..100), B=100)
multiplication_2 = Multiplication(A=division, B=multiplication)
round = Round(Number=multiplication_2)  # -> Nearest, Floor, Ceiling
random = Random(Range=Domain(0, 360), Number=16, Seed=2)  # -> flatten(Random)
random_2 = Random(Range=Domain(0, 360), Number=16, Seed=2)  # -> flatten(Random)
subtraction = Subtraction(A=multiplication, B=round.Nearest)
random_3 = Random(Range=Domain(0, 0), Number=subtraction, Seed=2)  # -> flatten(Random)
random_4 = Random(Range=Domain(1, 1), Number=round.Nearest, Seed=2)  # -> flatten(Random)
merge = Merge(Data1=random_4, Data2=random_3)
jitter = Jitter(List=merge, Jitter=1, Seed=2)  # -> Values, Indices
dispatch = Dispatch(List=subsrf, DispatchPattern=jitter.Values)  # -> ListA, ListB
sbox = SurfaceBox(Surface=srf, Domain=dispatch.ListA, Height=0.3)
morph = BoxMorph(Geometry=geo, Reference=bbox.Box, Target=sbox)
sbox_2 = SurfaceBox(Surface=srf, Domain=dispatch.ListB, Height=0.3)
morph_2 = BoxMorph(Geometry=geo_2, Reference=bbox_2.Box, Target=sbox_2)
group = Group(Objects=morph)
group_2 = Group(Objects=morph_2)
